# Grasshopper definition PterodactylTests.gh (Grasshopper 1.0.8)
# plug-ins: Pterodactyl, Brontosaurus

calendar = Calendar()
# Format
# Parts
# Report
# Tools
# Basic Graphs
# Advanced Graph
panel = Panel("Test")
strong = Strong(Text="Test")
emphasis = Emphasis(Text=panel)
strike = Strike(Text="Test")
underline = Underline(Text="Test")
txt = Text("**Test**")
txt_2 = Text("*Test*")
txt_3 = Text("~~Test~~")
# File path to directory with test files
panel_2 = Panel("C:\Users\pc\RiderProjects\Pterodactyl\TestsInsideGrasshopper\")
txt_4 = Text("<u>Test</u>")
panel_3 = Panel(txt)
panel_4 = Panel(txt_2)
panel_5 = Panel(txt_3)
assert = Assert(TestNames="Strong", Expected=txt, Actual=strong)  # -> Result, FailedInfo
# Format
assert_2 = Assert(TestNames="Emphasis", Expected=txt_2, Actual=emphasis)  # -> Result, FailedInfo
assert_3 = Assert(TestNames="Strike", Expected=txt_3, Actual=strike)  # -> Result, FailedInfo
panel_6 = Panel(txt_4)
assert_4 = Assert(TestNames="Underline", Expected=txt_4, Actual=underline)  # -> Result, FailedInfo
entwine = Entwine(Branch00=assert_2.Result, Branch01=assert_3.Result, Branch02=assert.Result, Branch03=assert_4.Result, FlattenInputs=True)  # -> flatten(Result)
path = FilePath(panel_2)
concat = Concatenate(FragmentA=path, FragmentB="logo pterodactyl 100x100px.png")
concat_2 = Concatenate(FragmentA=path, FragmentB="Viewport.png")
panel_7 = Panel("""Content
Of
First
Heading""")
panel_8 = Panel("""Content
Of
Second
Heading""")
panel_9 = Panel("""Third
Heading
Content
!""")
panel_10 = Panel("""First item
Second item""")
panel_11 = Panel("""First task
Second task""")
panel_12 = Panel("""First item
Second item""")
panel_13 = Panel("""False
True""")
path_2 = FilePath(concat)
series = Series(Start=1, Step=1, Count=6)
panel_14 = Panel("""x
y""")
panel_15 = Panel("""45
30""")
panel_16 = Panel("""Heading 1
Heading 2
Heading 3""")
path_3 = FilePath(concat_2)
horizontal_line = HorizontalLine()
heading = Heading(Text="Test", Level=series)
entwine_2 = Entwine(Branch00=panel_7, Branch01=panel_8, Branch02=panel_9, FlattenInputs=True)
quote = Quote(Text="Test")
page_break = PageBreak()
unordered_list = UnorderedList(Items=panel_12)
ordered_list = OrderedList(Items=panel_10)
task_list = TaskList(Tasks=panel_11, Done=panel_13)
viewport = Viewport(
    Title="My viewport",
    ViewportName="Góra",
    Path=path_3,
    DrawAxes=Toggle(True),
    DrawGrid=Toggle(True),
    DrawGridAxes=Toggle(True),
    TransparentBackground=Toggle(False))
image = Image(Title="Picture title", Path=path_2)
txt_5 = Text("------")
code_block = CodeBlock(ProgrammingLanguage="Python", Code="print(\"Hello world\")")
txt_6 = Text(["# Test", "## Test", "### Test", "#### Test", "##### Test", "###### Test"])
txt_7 = Text("[Test](www.google.com)")
txt_8 = Text("> Test")
txt_9 = Text("<div style=\"page-break-after: always;\"></div>")
panel_17 = Panel("""0
1
2""")
dynamic_math_block = DynamicMathBlock(Text="sin(<x>) + cos(<y>) = ?", VariablesSymbols=panel_14, VariablesValues=panel_15)
txt_10 = Text(["| Heading 1 | Heading 2 | Heading 3 |", "| --------- | :-------: | --------: |", "| Content   | Content   | Third     |", "| Of        | Of        | Heading   |", "| First     | Second    | Content   |", "| Heading   | Heading   | !         |"])
math_block = MathBlock(Text="sin(x) + cos(y) = ?")
txt_11 = Text("""1. First item
2. Second item""")
txt_12 = Text("""- [ ] First task
- [x] Second task""")
txt_13 = Text("""- First item
- Second item""")
panel_18 = Panel(txt_5)
panel_19 = Panel(txt_7)
assert_5 = Assert(TestNames="Horizontal Line", Expected=txt_5, Actual=horizontal_line)  # -> Result, FailedInfo
hyperlink = Hyperlink(Text="Test", Link="www.google.com")
panel_20 = Panel(txt_6)
panel_21 = Panel(txt_9)
panel_22 = Panel(txt_8)
assert_6 = Assert(TestNames="Page Break", Expected=txt_9, Actual=page_break)  # -> Result, FailedInfo
assert_7 = Assert(TestNames="Quote", Expected=txt_8, Actual=quote)  # -> Result, FailedInfo
table = Table(TableHeadings=panel_16, Alignment=panel_17, DataTree=entwine_2)
txt_14 = Text("""$$
sin(45) + cos(30) = ?
$$""")
# Parts
assert_list = AssertList(TestName="Heading", ExpectedList=txt_6, ActualList=heading)  # -> Result, FailedInfo
txt_15 = Text("""$$
sin(x) + cos(y) = ?
$$""")
panel_23 = Panel(txt_11)
panel_24 = Panel(txt_12)
panel_25 = Panel(txt_13)
txt_16 = Text("""```Python
print("Hello world")
```""")
panel_26 = Panel(txt_10)
txt_17 = Text("![Picture title](C:\Users\pc\RiderProjects\Pterodactyl\TestsInsideGrasshopper\logo pterodactyl 100x100px.png)")
assert_list_2 = AssertList(TestName="Ordered list", ExpectedList=txt_11, ActualList=ordered_list)  # -> Result, FailedInfo
assert_list_3 = AssertList(TestName="Unordered list", ExpectedList=txt_13, ActualList=unordered_list)  # -> Result, FailedInfo
txt_18 = Text("![My viewport](C:\Users\pc\RiderProjects\Pterodactyl\TestsInsideGrasshopper\Viewport.png)")
assert_list_4 = AssertList(TestName="Task list", ExpectedList=txt_12, ActualList=task_list)  # -> Result, FailedInfo
panel_27 = Panel(txt_14)
assert_8 = Assert(TestNames="Math Block", Expected=txt_15, Actual=math_block)  # -> Result, FailedInfo
panel_28 = Panel(txt_15)
panel_29 = Panel(txt_16)
assert_9 = Assert(TestNames="Image", Expected=txt_17, Actual=image)  # -> Result, FailedInfo
panel_30 = Panel(txt_17)
panel_31 = Panel(txt_18)
assert_10 = Assert(TestNames="Hyperlink", Expected=txt_7, Actual=hyperlink)  # -> Result, FailedInfo
assert_list_5 = AssertList(TestName="Code block", ExpectedList=txt_16, ActualList=code_block)  # -> Result, FailedInfo
assert_list_6 = AssertList(TestName="Dynamic Math Block", ExpectedList=txt_14, ActualList=dynamic_math_block)  # -> Result, FailedInfo
assert_11 = Assert(TestNames="Viewport", Expected=txt_18, Actual=viewport)  # -> Result, FailedInfo
assert_list_7 = AssertList(TestName="Table", ExpectedList=txt_10, ActualList=table)  # -> Result, FailedInfo
entwine_3 = Entwine(Branch00=assert_list_2.Result, Branch01=assert_list_4.Result, Branch02=assert_list_3.Result, FlattenInputs=True)  # -> flatten(Result)
entwine_4 = Entwine(
    Branch00=assert_list.Result,
    Branch01=assert_5.Result,
    Branch02=assert_10.Result,
    Branch03=assert_6.Result,
    Branch04=assert_7.Result,
    Branch05=assert_list_7.Result,
    FlattenInputs=True)  # -> flatten(Result)
entwine_5 = Entwine(Branch00=assert_list_5.Result, Branch01=assert_list_6.Result, Branch02=assert_8.Result, FlattenInputs=True)  # -> flatten(Result)
entwine_6 = Entwine(Branch00=assert_9.Result, Branch01=assert_11.Result, FlattenInputs=True)  # -> flatten(Result)
emphasis_2 = Emphasis(Text="Test")
strike_2 = Strike(Text="Test")
panel_32 = Panel("Emphasis")
panel_33 = Panel("Strike")
emphasis_3 = Emphasis(Text="Test")
strike_3 = Strike(Text="Test")
create_report = CreateReport(ReportParts=[emphasis_2, strike_2], Title="Report", TableOfContents=Toggle(False), AutoSpacing=Toggle(True))
# Report
create_report_2 = CreateReport(ReportParts=[emphasis_3, strike_3], Title="Report", TableOfContents=Toggle(True), AutoSpacing=Toggle(False))
concat_3 = Concatenate(FragmentA=path, FragmentB="ReportExampleWithAutospacing.md")
concat_4 = Concatenate(FragmentA=path, FragmentB="ReportExample.md")
panel_36 = Panel(create_report)
path_4 = FilePath(concat_3)
panel_37 = Panel(create_report_2)
path_5 = FilePath(concat_4)
txt_19 = Text("""# Report

*Test*

~~Test~~""")
save_report = SaveReport(Report=create_report, Path=path_4)
save_report_2 = SaveReport(Report=create_report_2, Path=path_5)
assert_12 = Assert(TestNames="Create Report With Autospacing", Expected=txt_19, Actual=create_report)  # -> Result, FailedInfo
panel_38 = Panel(txt_19)
txt_20 = Text("""# Report
[TOC]
*Test*
~~Test~~""")
assert_13 = Assert(TestNames="Create Report", Expected=txt_20, Actual=create_report_2)  # -> Result, FailedInfo
panel_39 = Panel(txt_20)
entwine_7 = Entwine(Branch00=assert_13.Result, Branch01=assert_12.Result, FlattenInputs=True)  # -> flatten(Result)
flowchart_start_node = FlowchartStartNode(Text="First", Shape=0)
panel_40 = Panel("""Category 1
Category 2
Category 3""")
panel_41 = Panel("""0.23
0.66
1.45""")
flowchart_link = FlowchartLink(Type="2", Node=flowchart_start_node, Text="Sample text")
flowchart_start_node_2 = FlowchartStartNode(Text="First Node", Shape=0)
flowchart_start_node_3 = FlowchartStartNode(Text="First Node", Shape=0)
flowchart_start_node_4 = FlowchartStartNode(Text="First", Shape=Slider(3, range=0..10))
flowchart_start_node_5 = FlowchartStartNode(Text="First", Shape=0)
flowchart_link_2 = FlowchartLink(Type="1", Node=flowchart_start_node_3, Text="My Link")
pie_chart = PieChart(Title="Title of chart", Categories=panel_40, Values=panel_41)
txt_21 = Text("""```mermaid
pie title Title of chart
    "Category 1" : 0.23
    "Category 2" : 0.66
    "Category 3" : 1.45
```""")
flowchart_node = FlowchartNode(Text="Second", NodeLink=flowchart_start_node, Shape=0)
flowchart_node_2 = FlowchartNode(Text="Third", NodeLink=flowchart_start_node, Shape=0)
flowchart_node_3 = FlowchartNode(Text="Fourth", NodeLink=flowchart_start_node, Shape=0)
flowchart_node_4 = FlowchartNode(Text="Sixth", NodeLink=flowchart_link, Shape="8")
flowchart_node_5 = FlowchartNode(Text="Second Node", NodeLink=flowchart_start_node_2, Shape=0)
flowchart_node_6 = FlowchartNode(Text="Second Node", NodeLink=flowchart_link_2, Shape=0)
flowchart_node_7 = FlowchartNode(Text="Second", NodeLink=flowchart_start_node_4, Shape=Slider(5, range=0..10))
flowchart_node_8 = FlowchartNode(Text="First", NodeLink=flowchart_start_node_5, Shape=0)
# Tools
panel_42 = Panel("Pie Chart")
panel_43 = Panel(txt_21)
assert_14 = Assert(TestNames=panel_42, Expected=txt_21, Actual=pie_chart)  # -> Result, FailedInfo
flowchart = Flowchart(Direction=Toggle(True), LastNodes=flowchart_node_5)
flowchart_2 = Flowchart(Direction=Toggle(True), LastNodes=flowchart_node_6)
flowchart_3 = Flowchart(Direction=Toggle(True), LastNodes=flowchart_node_7)
flowchart_4 = Flowchart(Direction=Toggle(True), LastNodes=flowchart_node_8)
flowchart_node_9 = FlowchartNode(Text="Fifth", NodeLink=[flowchart_node, flowchart_node_2, flowchart_node_3], Shape=0)
txt_22 = Text("""```mermaid
graph LR
First_Node --> Second_Node
```""")
txt_23 = Text("""```mermaid
graph LR
First_Node -- My Link --- Second_Node
```""")
txt_24 = Text("""```mermaid
graph LR
First[[First]] --> Second((Second))
```""")
txt_25 = Text("""```mermaid
graph LR
First --> First
```""")
panel_44 = Panel(txt_23)
panel_45 = Panel(txt_22)
panel_46 = Panel(txt_24)
panel_47 = Panel(txt_25)
assert_15 = Assert(TestNames="Simple flowchart", Expected=txt_22, Actual=flowchart)  # -> Result, FailedInfo
assert_16 = Assert(TestNames="Simple flowchart with link", Expected=txt_23, Actual=flowchart_2)  # -> Result, FailedInfo
assert_17 = Assert(TestNames="Different shapes", Expected=txt_24, Actual=flowchart_3)  # -> Result, FailedInfo
assert_18 = Assert(TestNames="Self pointing node", Expected=txt_25, Actual=flowchart_4)  # -> Result, FailedInfo
flowchart_5 = Flowchart(Direction=Toggle(True), LastNodes=[flowchart_node_9, flowchart_node_4])
txt_26 = Text("""```mermaid
graph LR
First --> Second
Second --> Fifth
First --> Third
Third --> Fifth
First --> Fourth
Fourth --> Fifth
First -. Sample text .-> Sixth{Sixth}
```""")
panel_48 = Panel(txt_26)
assert_19 = Assert(TestNames="Complex flowchart", Expected=txt_26, Actual=flowchart_5)  # -> Result, FailedInfo
entwine_8 = Entwine(
    Branch00=assert_14.Result,
    Branch01=assert_15.Result,
    Branch02=assert_16.Result,
    Branch03=assert_17.Result,
    Branch04=assert_18.Result,
    Branch05=assert_19.Result,
    FlattenInputs=True)  # -> flatten(Result)
concat_5 = Concatenate(FragmentA=path, FragmentB="LineGraph.png")
concat_6 = Concatenate(FragmentA=path, FragmentB="PieChart.png")
concat_7 = Concatenate(FragmentA=path, FragmentB="BarChart.png")
concat_8 = Concatenate(FragmentA=path, FragmentB="ColumnChart.png")
concat_9 = Concatenate(FragmentA=path, FragmentB="PointGraph.png")
path_6 = FilePath(concat_5)
path_7 = FilePath(concat_6)
path_8 = FilePath(concat_7)
path_9 = FilePath(concat_8)
path_10 = FilePath(concat_9)
bar_chart = BarChart(
    ShowGraph=False,
    Title="Wingspan comparison (size matters)",
    Values=[0.68, 0.81, 1, 1.2, 1.6, 6],
    BarNames=["Pigeon", "Duck", "Crow", "Owl", "Peacock", "Pterodactyl"],
    TextFormat="{0:0.00[m]}",
    Colors=[RGB(255, 110, 110), RGB(7, 173, 148), RGB(153, 255, 0), RGB(255, 119, 0), RGB(168, 45, 160), RGB(115, 115, 115)],
    Path=path_8)
column_chart = ColumnChart(
    ShowGraph=False,
    Title="Wingspan comparison (size matters)",
    Values=[0.68, 0.81, 1, 1.2, 1.6, 6],
    ColumnNames=["Pigeon", "Duck", "Crow", "Owl", "Peacock", "Pterodactyl"],
    TextFormat="{0:0.00[m]}",
    Colors=[RGB(255, 110, 110), RGB(7, 173, 148), RGB(153, 255, 0), RGB(255, 119, 0), RGB(168, 45, 160), RGB(115, 115, 115)],
    Path=path_9)
pie_chart_2 = PieChart(
    ShowGraph=False,
    Title="Reaction to Pterodactyl plugin",
    Values=[54, 34, 1],
    SlicesNames=["Happy", "Excited", "Holy cow"],
    Colors=[RGB(255, 119, 0), RGB(168, 45, 160), RGB(115, 115, 115)],
    Path=path_7)
point_graph = PointGraph(
    ShowGraph=False,
    Title="Awesomeness of Pterodactyl plugin",
    XValues=[0, 0.5, 1, 1.5, 2, 2.5, 3, 3.5, 4, 4.5],
    YValues=[1, 1.414214, 2, 2.828427, 4, 5.656854, 8, 11.313708, 16, 22.627417],
    XName="Time",
    YName="Awesomeness",
    Color=RGB(0, 0, 0),
    Path=path_10)
line_graph = LineGraph(
    ShowGraph=False,
    Title="Awesomeness of Pterodactyl plugin",
    XValues=[0, 0.5, 1, 1.5, 2, 2.5, 3, 3.5, 4, 4.5],
    YValues=[1, 1.414214, 2, 2.828427, 4, 5.656854, 8, 11.313708, 16, 22.627417],
    XName="Time",
    YName="Awesomeness",
    Color=RGB(0, 0, 0),
    Path=path_6)
txt_27 = Text("![Wingspan comparison (size matters)](C:\Users\pc\RiderProjects\Pterodactyl\TestsInsideGrasshopper\BarChart.png)")
txt_28 = Text("![Wingspan comparison (size matters)](C:\Users\pc\RiderProjects\Pterodactyl\TestsInsideGrasshopper\ColumnChart.png)")
# Basic Graphs
panel_49 = Panel("Bar Chart")
txt_29 = Text("![Awesomeness of Pterodactyl plugin](C:\Users\pc\RiderProjects\Pterodactyl\TestsInsideGrasshopper\LineGraph.png)")
txt_30 = Text("![Awesomeness of Pterodactyl plugin](C:\Users\pc\RiderProjects\Pterodactyl\TestsInsideGrasshopper\PointGraph.png)")
txt_31 = Text("![Reaction to Pterodactyl plugin](C:\Users\pc\RiderProjects\Pterodactyl\TestsInsideGrasshopper\PieChart.png)")
panel_50 = Panel(txt_27)
panel_51 = Panel(txt_28)
assert_20 = Assert(TestNames=panel_49, Expected=txt_27, Actual=bar_chart)  # -> Result, FailedInfo
assert_21 = Assert(TestNames="Column Chart", Expected=txt_28, Actual=column_chart)  # -> Result, FailedInfo
assert_22 = Assert(TestNames="Line Graph", Expected=txt_29, Actual=line_graph)  # -> Result, FailedInfo
panel_52 = Panel(txt_29)
assert_23 = Assert(TestNames="Point Graph", Expected=txt_30, Actual=point_graph)  # -> Result, FailedInfo
panel_53 = Panel(txt_30)
assert_24 = Assert(TestNames="Pie Chart", Expected=txt_31, Actual=pie_chart_2)  # -> Result, FailedInfo
panel_54 = Panel(txt_31)
entwine_9 = Entwine(
    Branch00=assert_20.Result,
    Branch01=assert_21.Result,
    Branch02=assert_22.Result,
    Branch03=assert_24.Result,
    Branch04=assert_23.Result,
    FlattenInputs=True)  # -> flatten(Result)
series_2 = Series(Start="0", Step="0.2", Count="50")
series_3 = Series(Start="0", Step="0.2", Count="50")
series_4 = Series(Start="0", Step="0.2", Count="50")
number_slider = Slider(0.4, range=0..11)
gradient = Gradient(LowerLimit="0", UpperLimit="10", Parameter=series_2, stops=[0: RGB(0, 128, 0), 0.5: RGB(255, 255, 0), 1: RGB(255, 0, 0)])
crv = Curve(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)
number_slider_2 = Slider(0.4, range=0..11)
gradient_2 = Gradient(
    LowerLimit="0",
    UpperLimit="10",
    Parameter=series_3,
    stops=[0: RGB(0, 98, 0), 0.25: RGB(81, 175, 17), 0.5: RGB(159, 198, 146), 0.75: RGB(170, 235, 41), 1: RGB(221, 255, 53)])
number_slider_3 = Slider(0.4, range=0..11)
gradient_3 = Gradient(LowerLimit="0", UpperLimit="10", Parameter=series_4, stops=[0.15: RGB(255, 130, 160), 0.85: RGB(220, 0, 40)])
crv_2 = Curve(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)
crv_3 = Curve(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)
divide = DivideCurve(Curve=crv, Count=Slider(50, range=0..100), Kinks=False)  # -> Points, Tangents, Parameters
lng = ListLength(List=divide.Parameters)
series_5 = Series(Start=Slider(0, range=0..100), Step=Slider(0.1, range=0..0.1), Count=Slider(50, range=0..100))
series_6 = Series(Start=number_slider, Step=number_slider, Count=lng)
series_7 = Series(Start=Slider(0, range=0..100), Step=Slider(0.2, range=0..10), Count=Slider(50, range=0..100))
divide_2 = DivideCurve(Curve=crv_2, Count=Slider(50, range=0..100), Kinks=False)  # -> Points, Tangents, Parameters
lng_2 = ListLength(List=divide_2.Parameters)
divide_3 = DivideCurve(Curve=crv_3, Count=Slider(50, range=0..100), Kinks=False)  # -> Points, Tangents, Parameters
lng_3 = ListLength(List=divide_3.Parameters)
line_data = LineData(Color=ColourSwatch(SwatchColor=RGB(252, 221, 66)), Interpolation=0, LineStyle=0, LineWeight=2)
series_8 = Series(Start=number_slider_2, Step=number_slider_2, Count=lng_3)
ln = NaturalLogarithm(Value=series_5)
log = Logarithm(Value=series_5)
series_9 = Series(Start=number_slider_3, Step=number_slider_3, Count=lng_2)
pdecon = Deconstruct(Point=divide.Points)  # -> XComponent, YComponent, ZComponent
line_data_2 = LineData(
    Color=ColourSwatch(SwatchColor=RGB(11, 184, 149)),
    Interpolation=Slider(1, range=0..4),
    LineStyle=Slider(1, range=0..4),
    LineWeight=2)
line_data_3 = LineData(
    Color=ColourSwatch(SwatchColor=RGB(120, 184, 11)),
    Interpolation=Slider(2, range=0..4),
    LineStyle=Slider(2, range=0..4),
    LineWeight=2)
line_data_4 = LineData(Color=ColourSwatch(SwatchColor=RGB(184, 11, 11)), Interpolation=0, LineStyle=Slider(3, range=0..4), LineWeight=2)
line_data_5 = LineData(
    Color=ColourSwatch(SwatchColor=RGB(0, 0, 0)),
    Interpolation=Slider(0, range=0..4),
    LineStyle=Slider(4, range=0..4),
    LineWeight=2)
series_10 = Series(Start=Slider(0, range=0..100), Step=Slider(0.1, range=0..0.1), Count=Slider(30, range=0..100))
line_data_6 = LineData(Color=ColourSwatch(SwatchColor=RGB(11, 184, 149)), Interpolation=0, LineStyle=0, LineWeight=2)
point_data = PointData(Color=ColourSwatch(SwatchColor=RGB(255, 0, 234)), Marker=1, Size=4.5)
scatter_data = ScatterData(Values=divide.Parameters, Sizes=series_6, Marker=Slider(6, range=0..10), ColorPalette=gradient)
sin = Sine(Value=series_7)
point_anntotation = PointAnnotation(Text=sin, Size="6", Placement=Slider(0, range=0..4))
# Advanced Graph
entwine_10 = Entwine(Branch00=series_5, Branch01=series_5, FlattenInputs=True)
entwine_11 = Entwine(Branch00=ln, Branch01=log, FlattenInputs=True)
pdecon_2 = Deconstruct(Point=divide_2.Points)  # -> XComponent, YComponent, ZComponent
pdecon_3 = Deconstruct(Point=divide_3.Points)  # -> XComponent, YComponent, ZComponent
cube = Cube(Value=series_10)
cbrt = CubeRoot(Value=series_10)
sqr = Square(Value=series_10)
scatter_data_2 = ScatterData(Values=divide_3.Parameters, Sizes=series_8, Marker=Slider(1, range=0..10), ColorPalette=gradient_2)
panel_55 = Panel("""LN
LOG""")
scatter_data_3 = ScatterData(Values=divide_2.Parameters, Sizes=series_9, Marker=Slider(6, range=0..10), ColorPalette=gradient_3)
entwine_12 = Entwine(Branch00=series_7, Branch01=series_7, FlattenInputs=True)
entwine_13 = Entwine(Branch00=sin, Branch01=sin, FlattenInputs=True)
entwine_14 = Entwine(Branch00=cube, Branch01=cbrt, Branch02=sqr, Branch03=series_10, FlattenInputs=True)
panel_56 = Panel("""cube
cube root
power
linear""")
entwine_15 = Entwine(Branch00=series_10, Branch01=series_10, Branch02=series_10, Branch03=series_10, FlattenInputs=True)
entwine_16 = Entwine(Branch00=pdecon_2.XComponent, Branch01=pdecon_3.XComponent, FlattenInputs=True)
entwine_17 = Entwine(Branch00=pdecon_2.YComponent, Branch01=pdecon_3.YComponent, FlattenInputs=True)
entwine_18 = Entwine(Branch00=line_data, Branch01=point_anntotation, FlattenInputs=True)  # -> flatten(Result)
panel_57 = Panel("""SIN
Text""")
entwine_19 = Entwine(Branch00=line_data_2, Branch01=line_data_3, Branch02=line_data_4, Branch03=line_data_5, FlattenInputs=True)  # -> flatten(Result)
graph_data = GraphData(XValues=entwine_10, YValues=entwine_11, ValuesNames=panel_55, DataType=[line_data_6, point_data])
graph_data_2 = GraphData(XValues=pdecon.XComponent, YValues=pdecon.YComponent, ValuesNames="Circle", DataType=scatter_data)
graph_axis = GraphAxis(XAxisName="My X Axis", YAxisName="My Y Axis", AxisPadding=Slider(0, range=0..10), TextSize=Slider(10, range=0..100))
graph_data_3 = GraphData(XValues=entwine_12, YValues=entwine_13, ValuesNames=panel_57, DataType=entwine_18)
graph_sizes = GraphSizes(Width="550", Height="500")
graph_data_4 = GraphData(XValues=entwine_15, YValues=entwine_14, ValuesNames=panel_56, DataType=entwine_19)
graph_data_5 = GraphData(XValues=entwine_16, YValues=entwine_17, ValuesNames=["Circle", "Rectangle"], DataType=[scatter_data_3, scatter_data_2])
graph_legend = GraphLegend(Title="Legend", Position="11", Placement=0, Orientation=1, TextSize=12)
graph_axis_2 = GraphAxis(XAxisName="My X Axis", YAxisName="My Y Axis", AxisPadding=Slider(0, range=0..10), TextSize=Slider(10, range=0..100))
graph_axis_3 = GraphAxis(XAxisName="My X Axis", YAxisName="My Y Axis", AxisPadding=Slider(0, range=0..10), TextSize=Slider(10, range=0..100))
graph_sizes_2 = GraphSizes(Width="650", Height="500")
graph_axis_4 = GraphAxis(XAxisName="My X Axis", YAxisName="My Y Axis", AxisPadding=0.01, TextSize=12)
graph_legend_2 = GraphLegend(
    Title="Legend",
    Position="11",
    Placement=Slider(1, range=0..1),
    Orientation=Slider(1, range=0..1),
    TextSize=Slider(10, range=0..10))
graph_sizes_3 = GraphSizes(Width="1000", Height="400")
graph_sizes_4 = GraphSizes(Width="1000", Height="500")
graph_legend_3 = GraphLegend(Title="Legend", Position="11", Placement=0, Orientation=1, TextSize=12)
graph_axis_5 = GraphAxis(XAxisName="My X Axis", YAxisName="My Y Axis", AxisPadding=0.01, TextSize=12)
graph_sizes_5 = GraphSizes(Width="1000", Height="400")
graph_legend_4 = GraphLegend(
    Title="Legend",
    Position="11",
    Placement=Slider(0, range=0..1),
    Orientation=Slider(1, range=0..1),
    TextSize=Slider(10, range=0..10))
graph_elements = GraphElements(GraphData=graph_data, GraphLegend=graph_legend)
graph_legend_5 = GraphLegend(Position="11", Placement=Slider(0, range=0..1), Orientation=Slider(1, range=0..1), TextSize=Slider(10, range=0..10))
graph_elements_2 = GraphElements(GraphData=graph_data_3, GraphLegend=graph_legend_2)
graph_elements_3 = GraphElements(GraphData=graph_data_4, GraphLegend=graph_legend_3)
graph_settings = GraphSettings(
    Title="Scatter data",
    GraphSizes=graph_sizes,
    Color=ColourSwatch(SwatchColor=RGBA(255, 255, 255, 221)),
    GraphAxis=graph_axis,
    GraphPadding=Slider(0, range=0..110),
    TitleSize=Slider(10, range=0..100))
concat_10 = Concatenate(FragmentA=path, FragmentB="ScatterChart.png")
graph_elements_4 = GraphElements(GraphData=graph_data_2, GraphLegend=graph_legend_4)
graph_settings_2 = GraphSettings(
    Title="My title",
    GraphSizes=graph_sizes_3,
    Color=ColourSwatch(SwatchColor=RGB(196, 196, 196)),
    GraphAxis=graph_axis_4,
    GraphPadding=8,
    TitleSize=18)
graph_settings_3 = GraphSettings(
    Title="Scatter data",
    GraphSizes=graph_sizes_2,
    Color=ColourSwatch(SwatchColor=RGBA(255, 255, 255, 221)),
    GraphAxis=graph_axis_3,
    GraphPadding=Slider(0, range=0..110),
    TitleSize=Slider(10, range=0..100))
concat_11 = Concatenate(FragmentA=path, FragmentB="MultipleScatter.png")
path_11 = FilePath(concat_10)
concat_12 = Concatenate(FragmentA=path, FragmentB="AdvancedChart.png")
graph_elements_5 = GraphElements(GraphData=graph_data_5, GraphLegend=graph_legend_5)
graph_settings_4 = GraphSettings(
    Title="Sinus",
    GraphSizes=graph_sizes_4,
    Color=ColourSwatch(SwatchColor=RGB(196, 196, 196)),
    GraphAxis=graph_axis_2,
    GraphPadding=Slider(10, range=0..10),
    TitleSize=Slider(10, range=0..100))
graph_settings_5 = GraphSettings(
    Title="My title",
    GraphSizes=graph_sizes_5,
    Color=ColourSwatch(SwatchColor=RGB(196, 196, 196)),
    GraphAxis=graph_axis_5,
    GraphPadding=8,
    TitleSize=18)
path_12 = FilePath(concat_11)
concat_13 = Concatenate(FragmentA=path, FragmentB="DifferentLines.png")
path_13 = FilePath(concat_12)
concat_14 = Concatenate(FragmentA=path, FragmentB="ChartMixedWithTextTags.png")
path_14 = FilePath(concat_13)
graph = Graph(ShowGraph=False, GraphElements=graph_elements, GraphSettings=graph_settings_2, Path=path_13)
path_15 = FilePath(concat_14)
graph_2 = Graph(ShowGraph=Button(), GraphElements=graph_elements_4, GraphSettings=graph_settings, Path=path_11)
graph_3 = Graph(ShowGraph=Button(), GraphElements=graph_elements_3, GraphSettings=graph_settings_5, Path=path_14)
graph_4 = Graph(ShowGraph=Button(), GraphElements=graph_elements_5, GraphSettings=graph_settings_3, Path=path_12)
graph_5 = Graph(ShowGraph=Button(), GraphElements=graph_elements_2, GraphSettings=graph_settings_4, Path=path_15)
txt_32 = Text("![Scatter data](C:\Users\pc\RiderProjects\Pterodactyl\TestsInsideGrasshopper\ScatterChart.png)")
txt_33 = Text("![Scatter data](C:\Users\pc\RiderProjects\Pterodactyl\TestsInsideGrasshopper\MultipleScatter.png)")
txt_34 = Text("![My title](C:\Users\pc\RiderProjects\Pterodactyl\TestsInsideGrasshopper\AdvancedChart.png)")
txt_35 = Text("![Sinus](C:\Users\pc\RiderProjects\Pterodactyl\TestsInsideGrasshopper\ChartMixedWithTextTags.png)")
assert_25 = Assert(TestNames="ScatterData", Expected=txt_32, Actual=graph_2)  # -> Result, FailedInfo
panel_58 = Panel(txt_32)
txt_36 = Text("![My title](C:\Users\pc\RiderProjects\Pterodactyl\TestsInsideGrasshopper\DifferentLines.png)")
assert_26 = Assert(TestNames="MultipleScatter", Expected=txt_33, Actual=graph_4)  # -> Result, FailedInfo
panel_59 = Panel(txt_33)
assert_27 = Assert(TestNames="Advanced Chart", Expected=txt_34, Actual=graph)  # -> Result, FailedInfo
panel_60 = Panel(txt_34)
assert_28 = Assert(TestNames="ChartMixedWithTextTags", Expected=txt_35, Actual=graph_5)  # -> Result, FailedInfo
panel_61 = Panel(txt_35)
panel_62 = Panel(txt_36)
assert_29 = Assert(TestNames="DifferentLines", Expected=txt_36, Actual=graph_3)  # -> Result, FailedInfo
entwine_20 = Entwine(
    Branch00=assert_27.Result,
    Branch01=assert_28.Result,
    Branch02=assert_25.Result,
    Branch03=assert_29.Result,
    Branch04=assert_26.Result,
    FlattenInputs=True)  # -> flatten(Result)
total = Total(Results=[entwine, entwine_4, entwine_3, entwine_5, entwine_6, entwine_7, entwine_8, entwine_9, entwine_20])  # -> TotalResult, ReportPart
panel_63 = Panel(total.TotalResult)
