# Grasshopper definition example.gh (Grasshopper 1.0.7)
# Copyright: All Rights Reserved
# plug-ins: Pterodactyl

pts = Slider(63, range=0..300)
pts_2 = Slider(1200, range=0..2000)
brep = Brep(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)
brep_2 = Brep(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)
populate_geometry = PopulateGeometry(Geometry=brep_2, Count=pts_2, Seed=pts)
# Gradient here is different so you can see in the graph
cluster = Cluster(geometry=brep, count=pts_2, seed=pts)  # -> x_component, y_component, z_component, colour, mapped
# length should be same as upper series
number_slider = Slider(3, range=0..10)
# C values are different than x and y
series = Series(Start=0, Step=25, Count=100)
list_length = ListLength(List=series)
deconstruct = Deconstruct(Point=populate_geometry)  # -> XComponent, YComponent, ZComponent
# You can change also the size of the dots by z value
construct_domain = ConstructDomain(DomainStart=0.7, DomainEnd=4.7)
sort_list = SortList(Keys=deconstruct.ZComponent, ValuesValuesA=deconstruct.ZComponent)  # -> Keys, ValuesValuesA
bounds = Bounds(Numbers=deconstruct.ZComponent)
series_2 = Series(Start=0, Step=0.1, Count=100)
duplicate_data = DuplicateData(Data=number_slider, Number=list_length, Order=True)
remap_numbers = RemapNumbers(Value=deconstruct.ZComponent, Source=bounds, Target=construct_domain)  # -> Mapped, Clipped
deconstruct_domain = DeconstructDomain(Domain=bounds)  # -> Start, End
square_root = SquareRoot(Value=series_2)
square_root_2 = SquareRoot(Value=series_2)
# You can change the gradient from here to
# show something like space heatmap in this
# example
gradient = Gradient(
    LowerLimit=deconstruct_domain.Start,
    UpperLimit=deconstruct_domain.End,
    Parameter=sort_list.ValuesValuesA,
    stops=[0: RGB(0, 98, 0), 0.25: RGB(81, 175, 17), 0.5: RGB(159, 198, 146), 0.75: RGB(170, 235, 41), 1: RGB(221, 255, 53)])
list_length_2 = ListLength(List=deconstruct.ZComponent)
multiplication = Multiplication(A=square_root_2, B=3)
line_data = LineData(Color=RGB(0, 0, 0), Interpolation=0, LineStyle=0, LineWeight=2)
# If we dont flatten then Graph Data gives
# error. Have to use tree but I don't know how
# to put double in GH_Structure<T> as T is
# not accepting it
# 
# Also order of attaching the wires dictates
# which series we will colour
scatter_data = ScatterData(Palette=[RGB(0, 0, 0), RGB(255, 165, 0), RGB(255, 0, 0)], Marker=1, Sizes=duplicate_data, Values=series)
panel = Panel("""sqrt
scatter range""")
entwine = Entwine(Branch00=series_2, Branch01=series_2, FlattenInputs=True)
entwine_2 = Entwine(Branch00=square_root, Branch01=multiplication, FlattenInputs=True)
duplicate_data_2 = DuplicateData(Data=Slider(3, range=0..10), Number=list_length_2, Order=True)  # -> flatten(FixSize)
scatter_data_2 = ScatterData(Palette=gradient, Marker=1, Sizes=remap_numbers.Mapped, Values=deconstruct.ZComponent)
panel_2 = Panel("""3d sphere
3d prism""")
scatter_data_3 = ScatterData(Palette=cluster.colour, Marker=1, Sizes=cluster.mapped, Values=cluster.z_component)
entwine_3 = Entwine(Branch00=cluster.y_component, Branch01=deconstruct.XComponent, FlattenInputs=True)
entwine_4 = Entwine(Branch00=cluster.x_component, Branch01=deconstruct.YComponent, FlattenInputs=True)
graph_legend = GraphLegend(Title="Legend", Position=0, Placement=0, Orientation=Toggle(True))
graph_data = GraphData(XValues=entwine_2, YValues=entwine, ValuesNames=panel, DataType=[line_data, scatter_data])
graph_axis = GraphAxis(XAxisName="x", YAxisName="y", AxisPadding=0.01)
graph_sizes = GraphSizes(Width=800, Height=640)
graph_elements = GraphElements(GraphData=graph_data, GraphLegend=graph_legend)
graph_settings = GraphSettings(
    Title="scatter",
    TitleSize=16,
    GraphSizes=graph_sizes,
    Background=RGB(255, 255, 255),
    GraphAxis=graph_axis,
    GraphPadding=10)
graph_legend_2 = GraphLegend(Position=0, Placement=Toggle(False), Orientation=Toggle(False))
graph_data_2 = GraphData(XValues=entwine_4, YValues=entwine_3, ValuesNames=panel_2, DataType=[scatter_data_2, scatter_data_3])
graph_axis_2 = GraphAxis(XAxisName="x (mm)", YAxisName="y (mm)", AxisPadding=Slider(0.1, range=0..0.1))
graph_sizes_2 = GraphSizes(Width=1000, Height=800)
graph = Graph(ShowGraph=Toggle(True), GraphElements=graph_elements, GraphSettings=graph_settings)
graph_elements_2 = GraphElements(GraphData=graph_data_2, GraphLegend=graph_legend_2)
graph_settings_2 = GraphSettings(
    Title="scatter 3D",
    TitleSize=16,
    GraphSizes=graph_sizes_2,
    Background=RGB(255, 255, 255),
    GraphAxis=graph_axis_2,
    GraphPadding=Slider(25, range=0..25))
graph_2 = Graph(ShowGraph=Toggle(True), GraphElements=graph_elements_2, GraphSettings=graph_settings_2)

# ==== cluster Cluster
geometry = ClusterInput()
count = ClusterInput()
seed = ClusterInput()
populate_geometry = PopulateGeometry(Geometry=geometry, Count=count, Seed=seed)
deconstruct = Deconstruct(Point=populate_geometry)  # -> XComponent, YComponent, ZComponent
# You can change also the size of the dots by z value
construct_domain = ConstructDomain(DomainStart=0.7, DomainEnd=4.7)
sort_list = SortList(Keys=deconstruct.ZComponent, ValuesValuesA=deconstruct.ZComponent)  # -> Keys, ValuesValuesA
bounds = Bounds(Numbers=deconstruct.ZComponent)
x_component = ClusterOutput(deconstruct.XComponent)
y_component = ClusterOutput(deconstruct.YComponent)
z_component = ClusterOutput(deconstruct.ZComponent)
remap_numbers = RemapNumbers(Value=deconstruct.ZComponent, Source=bounds, Target=construct_domain)  # -> Mapped, Clipped
deconstruct_domain = DeconstructDomain(Domain=bounds)  # -> Start, End
mapped = ClusterOutput(remap_numbers.Mapped)
gradient = Gradient(
    LowerLimit=deconstruct_domain.Start,
    UpperLimit=deconstruct_domain.End,
    Parameter=sort_list.ValuesValuesA,
    stops=[0: RGB(0, 128, 0), 0.5: RGB(255, 255, 0), 1: RGB(255, 0, 0)])
list_length = ListLength(List=deconstruct.ZComponent)
duplicate_data = DuplicateData(Data=Slider(3, range=0..10), Number=list_length, Order=True)  # -> flatten(FixSize)
colour = ClusterOutput(gradient)
